vi "index.gviweb"   [LabVIEW NXG 4.0.0]
panel controls:
  "url for getting values from google firebase": string
  "url for sending values to google firebase": string
  "Relay control": bool
panel indicators:
  "Unit Consumed": f64
  "Amount to Pay": f64
  "Tab_2": i32
  "Linear Progress Bar_2": f64
  "URL Image": string
  "URL Image_2": string
  "URL Image_3": string
  "URL Image_4": string
uses:
  NI::HTTP::Open HTTP Handle.gvi
  NI::HTTP::GET.gvi
  NI::G Core::Strings::Search and Replace Pattern.gvi
  NI::HTTP::PUT Buffer.gvi
  NI::HTTP::Close HTTP Handle.gvi
diagram:
  call "Open HTTP Handle.gvi"() -> (client handle out=w1, error out=w2)
  while {
    call "GET.gvi"(client handle=w1, url=$"url for getting values from google firebase", error in=w2) -> (client handle out=w3, body=w4, error out=w5)
    Search Or Split String(search string/char=",", string=w4) -> (match + rest of string=w6, substring before match=w7)
    Search Or Split String(search string/char="\",", string=w6) -> (match + rest of string=w8, substring before match=w9)
    call "Search and Replace Pattern.gvi"(string=w8, pattern="\"]") -> (result string=w10)
    call "Search and Replace Pattern.gvi"(string=w10, pattern="\",\"") -> (result string=w11)
    Decimal String To Number(string=w11) -> (number=w12)
    $Tab_2 <- w12
    Is Equal To 0(x=w12) -> w13
    Not(x=w13) -> w14
    Logical And(w14, $"Relay control") -> w15
    Select(s=w15, t=100, f=0) -> w16
    for (N = w16) (iteration -> i1) {
      Wait(time to wait=10)
      $"Linear Progress Bar_2" <- i1
    }
    call "Search and Replace Pattern.gvi"(string=w9, pattern=",\"") -> (result string=w17)
    Floating Point String To Number(string=w17) -> (number=w18)
    To Double Precision Float(number=w18) -> w19
    $"Amount to Pay" <- w19
    Search Or Split String(search string/char="\"", string=w7) -> (match + rest of string=w20)
    call "Search and Replace Pattern.gvi"(string=w20, pattern="\"") -> (result string=w21)
    call "Search and Replace Pattern.gvi"(string=w21, pattern="\"") -> (result string=w22)
    Floating Point String To Number(string=w22) -> (number=w23)
    $"Unit Consumed" <- w23
    Boolean To 0 Or 1(Boolean=$"Relay control") -> (0, 1=w24)
    Build Cluster(w24) -> w25
    Flatten To JSON(anything=w25) -> (JSON string=w26)
    call "PUT Buffer.gvi"(client handle=w3, url=$"url for sending values to google firebase", buffer=w26, error in=w5) -> (client handle out=w27, error out=w28)
    Wait(time to wait=100)
    stop if FALSE
  }
  call "Close HTTP Handle.gvi"(client handle=w27, error in=w28)
